# Dynamo graph FILE DYNAMO GUI TEAM IOT.dyn "Modeling Pile from CAD - no package" (Dynamo 2.19.3.6394)
# packages: bimorphNodes 4.0.3

curvesFromCADLayers = CAD.CurvesFromCADLayers()  # unwired: importInstance
code_block = CodeBlock { x:int[]; }  # unwired: x
code_block_2 = CodeBlock { "Diameter(Ø)_Pile"; }

# group: INPUT
# note: Chọn Family cọc với đường kính min. Đối với file CAD có cọc dạng ly tâm (2 vòng tròn đồng tâm) thì phải tạo đường kính cọc min > đường kính max của vòng tròng trong
chọn_family_cọc = FamilyTypes("Pile_BIMLAB:PILE_D800")  # graph input

family = FamilyType.Family(familyType=chọn_family_cọc)
types = Family.Types(family=family)

# group: INPUT
tên_paramter_thể_hiện_đường_kính = StringInput("Diameter(Ø)_Pile")  # "Tên Paramter thể hiện ĐƯỜNG KÍNH cọc"; graph input

getParameterValueByName = Element.GetParameterValueByName(element=types, parameterName=tên_paramter_thể_hiện_đường_kính)
string_from_object = FromObject(object=getParameterValueByName)

# group: INPUT
quét_chọn_file_cad_or_link_cad = DSModelElementsSelection()  # 1 picked in the model; graph input

# group: INPUT
chọn_layer_cọc_trong_cad = StringInput("1")  # graph input

list_create = List.Create(item0=chọn_layer_cọc_trong_cad)
python_script = Python(IN[0]=quét_chọn_file_cad_or_link_cad, IN[1]=list_create)  # CPython3
# ---------- python_script.python (111 lines) ----------
import clr

# Revit API
clr.AddReference("RevitAPI")
from Autodesk.Revit.DB import *

# Dynamo Geometry
clr.AddReference("ProtoGeometry")
from Autodesk.DesignScript.Geometry import *

# Dynamo Revit
clr.AddReference("RevitNodes")
import Revit
clr.ImportExtensions(Revit.Elements)

cad = UnwrapElement(IN[0])

layerNames = IN[1]

if layerNames is None:
    layerNames = []

if not isinstance(layerNames, list):
    layerNames = [layerNames]

opt = Options()
geo = cad.get_Geometry(opt)

layerDict = {}

# chống trùng Circle
circleKeys = set()

def addCircle(layer, circle):

    if layer not in layerDict:
        layerDict[layer] = []

    layerDict[layer].append(circle)

def walk(geoSet):

    for g in geoSet:

        if isinstance(g, GeometryInstance):

            walk(g.GetInstanceGeometry())

        else:

            try:

                style = cad.Document.GetElement(g.GraphicsStyleId)

                if style is None:
                    continue

                layer = style.GraphicsStyleCategory.Name

                if layerNames and layer not in layerNames:
                    continue

                # Chỉ lấy Arc
                if g.GetType().Name != "Arc":
                    continue

                center = g.Center

                # feet -> mm
                x = center.X * 304.8
                y = center.Y * 304.8
                z = center.Z * 304.8

                radius = g.Radius * 304.8

                # loại bỏ Arc trùng tâm
                key = (
                    round(x,3),
                    round(y,3),
                    round(z,3),
                    round(radius,3)
                )

                if key in circleKeys:
                    continue

                circleKeys.add(key)

                pt = Point.ByCoordinates(x,y,z)

                dsCircle = Circle.ByCenterPointRadius(
                    pt,
                    radius
                )

                addCircle(layer, dsCircle)

            except:
                pass

walk(geo)

# xuất giống Bimorph
layerKeys = sorted(layerDict.keys())

curveGroups = []

for k in layerKeys:
    curveGroups.append(layerDict[k])

OUT = curveGroups
# ----------------------------------------
flatten = List.Flatten(list=python_script)
radius = Circle.Radius(circle=flatten)
code_block_3 = CodeBlock(a=radius) { 2*a; }
string_from_object_2 = FromObject(object=code_block_3)
indexOf = List.IndexOf(list=string_from_object, element=string_from_object_2)
getItemAtIndex = List.GetItemAtIndex(list=types, index=indexOf)
centerPoint = Circle.CenterPoint(circle=flatten)
X = Point.X(point=centerPoint)
Y = Point.Y(point=centerPoint)
list_create_2 = List.Create(item0=X, item1=Y)
code_block_4 = CodeBlock(a=list_create_2) { a[0]; }
code_block_5 = CodeBlock(a=list_create_2) { a[1]; }
Z = Point.Z(point=centerPoint)
byCoordinates = Point.ByCoordinates(x=code_block_4, y=code_block_5, z=Z)

# group: INPUT
level_đặt_cọc = Levels("L1")  # graph input

byPointAndLevel = FamilyInstance.ByPointAndLevel(familyType=getItemAtIndex, point=byCoordinates, level=level_đặt_cọc)
